% Simulink data dictionary Ref.sldd

Bus = Simulink.Bus()
  a: double
  a1: double
  a2: double
  a3: double

Param = myPackage.Parameter(12, DoubleProperty=0, Int32Property=int32(0), LogicalProperty=false, OnOffCharProperty="off", ColorCharProperty="red", StorageClass="YS_SelectRAMPara", HeaderFile="define.h", DefinitionFile="define.c", DataType="single")
Sig = myPackage.Signal(DoubleProperty=0, Int32Property=int32(0), LogicalProperty=false, OnOffCharProperty="off", ColorCharProperty="red", InitialValue="0", StorageClass="YS_SelectRAMSignal", HeaderFile="define.h", DefinitionFile="define.c", DataType="single")